# Grasshopper definition 20160109_funicular_K1 LD.gh (Grasshopper 1.0.7)
# plug-ins: Kangaroo Components, Kangaroo2 Components

feet_width = Slider(2.041, range=0..3)
crv = Curve([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])
dent = Slider(0, range=0..1)
feet_width_2 = Slider(3, range=0..10)
cp = ControlPoints(Curve=crv)  # -> Points, Weights, Knots
# https://discourse.mcneel.com/t/pleated-surface/92334/5
# 
# 22/11/2019
# Laurent Delrieu
# l.delrieu@neuf.fr
avr = Average(Input=flatten(cp.Points))
crv_2 = Curve([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])
scale = Scale(Geometry=crv, Center=avr, Factor=feet_width)  # -> Geometry, Transform
tolerance_for_stitching_lines = Panel("0.001")
dent_2 = Panel("1")
feet_roundness = Slider(80, range=-170..180)
feet_width_3 = Panel("3")

# ---- group: Play with that to reset Kangaroo
toggle = BooleanToggle(True)
button = Button()

# ----
spring_u_length = Slider(0.5, range=0.5..6)

# ---- group: Inflate to 0 at beginning
inflate = Slider(-0.5, range=-2..2)

# ----
spring_v_length = Slider(0.5, range=0.5..6)

mass = Slider(0.974, range=0..10)
rad = Radians(Degrees=feet_roundness)
c_script = CSharpScript(
    lines_in=scale.Geometry,
    tolerance=tolerance_for_stitching_lines,
    width=feet_width_2,
    deviation=dent,
    angle=rad,
    n_u=Slider(9, range=1..10),
    n_v=Slider(9, range=1..10),
    zbool=Toggle(False))  # -> out, P, LP, PP, PL, lines, ends, connect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; inputs lines_in: list of Line, tolerance: Double, width: Double, deviation: Double, angle: Double, n_u: Int32, n_v: Int32, zbool: Boolean
# ---------- c_script: C# ----------
    //OUT data
    List<Point3d> points = new List<Point3d>();
    DataTree<int> lineVertex = new DataTree<int>();
    DataTree<int> vertexVertexes = new DataTree<int>();
    DataTree<int> vertexLine = new DataTree<int>();

    List<Line> linesOut = new List<Line>();
    DataTree<Line> linesBranch = new DataTree<Line>();
    bool isEnd;
    List<Line> linesEnd = new List<Line>();

    List<LDPanel> panels = new List<LDPanel>();

    ///BEGIN TEST INPUTS
    if (lines_in == null) return;

    if (lines_in.Count < 1)
    {
      this.Component.AddRuntimeMessage(GH_RuntimeMessageLevel.Error, "There must be more than 1 line");
      return;
    }
    LineTopology(lines_in, tolerance, ref points, ref  lineVertex, ref vertexVertexes, ref vertexLine);


    for (int i = 0; i < lineVertex.BranchCount; i++)
    {
      Line lineOut = new Line();
      LDSide side1 = new LDSide();
      LDSide side2 = new LDSide();

      lineOut = LinePerp(points, lineVertex, vertexVertexes, true, true, i, width, out isEnd);
      if (isEnd) linesEnd.Add(lineOut);
      linesBranch.Add(lineOut, new GH_Path(i * 2));
      side1 = new LDSide(lineVertex.Branch(i)[1], points[lineVertex.Branch(i)[1]], lineOut.Direction, isEnd);

      lineOut = LinePerp(points, lineVertex, vertexVertexes, false, false, i, width, out isEnd);
      if (isEnd) linesEnd.Add(lineOut);
      linesBranch.Add(lineOut, new GH_Path(i * 2));
      side2 = new LDSide(lineVertex.Branch(i)[0], points[lineVertex.Branch(i)[0]], lineOut.Direction, isEnd);
      panels.Add(new LDPanel(side1, side2, i));

      lineOut = LinePerp(points, lineVertex, vertexVertexes, false, true, i, width, out isEnd);
      if (isEnd) linesEnd.Add(lineOut);
      linesBranch.Add(lineOut, new GH_Path(i * 2 + 1));
      side1 = new LDSide(lineVertex.Branch(i)[0], points[lineVertex.Branch(i)[0]], lineOut.Direction, isEnd);

      lineOut = LinePerp(points, lineVertex, vertexVertexes, true, false, i, width, out isEnd);
      if (isEnd) linesEnd.Add(lineOut);
      linesBranch.Add(lineOut, new GH_Path(i * 2 + 1));
      side2 = new LDSide(lineVertex.Branch(i)[1], points[lineVertex.Branch(i)[1]], lineOut.Direction, isEnd);
      panels.Add(new LDPanel(side1, side2, i));
    }

    DataTree<LDPanel> treePanels = new DataTree<LDPanel>();
    DataTree<int> treeInt = new DataTree<int>();

    int test = 0;
    int branch = 0;
    while ((panels.Count > 0) && (test < 100))
    {
      treePanels.Add(panels[0], new GH_Path(branch));
      treeInt.Add(panels[0].lineNumber, new GH_Path(branch));
      panels.RemoveAt(0);

      int intersections = 0;
      do
      {
        List<LDPanel> intPanels = GetIntersections(treePanels.Branch(branch), panels);
        intersections = intPanels.Count;
        for (int i = (intPanels.Count - 1); i >= 0; i--)
        {
          treePanels.Add(intPanels[i], new GH_Path(branch));
          treeInt.Add(intPanels[i].lineNumber, new GH_Path(branch));
          panels.Remove(intPanels[i]);
        }
      } while (intersections > 0);
      test += 1;
      branch += 1;
    }
    DataTree<Brep> brepTree = new DataTree<Brep>();

    for (int i = 0; i < treePanels.BranchCount; i++)
    {
      for (int j = 0; j < treePanels.Branch(i).Count; j++)
      {
        brepTree.Add(treePanels.Branch(i)[j].ToBrep(), new GH_Path(i));
      }
    }
    DataTree<Mesh> meshTree = new DataTree<Mesh>();
    List<Point3d> fixedPoints = new List<Point3d>();
    DataTree<LineCurve> listUCurves = new DataTree<LineCurve> ();
    DataTree<LineCurve> listVCurves = new DataTree<LineCurve> ();

    for (int i = 0; i < treePanels.BranchCount; i++)
    {
      for (int j = 0; j < treePanels.Branch(i).Count; j++)
      {
        meshTree.Add(treePanels.Branch(i)[j].ToMesh(n_u, n_v, angle, width, ref fixedPoints, ref listUCurves, ref  listVCurves, deviation, zbool), new GH_Path(i));
      }
    }
    P = points;
    LP = lineVertex;
    PP = vertexVertexes;
    PL = vertexLine;
    lines = linesBranch;
    ends = linesEnd;
    connect = treeInt;
    brep = brepTree;
    M = meshTree;
    F = fixedPoints;
    U = listUCurves;
    V = listVCurves;
# ---------- c_script: C# additional code ----------
  public Line LinePerp(List<Point3d> points, DataTree<int> lineVertex, DataTree<int> vertexVertexes, bool one, bool two, int i, double width, out bool isEnd)
  {
    int i0, i1;
    double signe = 1.0;
    if (one)
    {
      i0 = 0;
      i1 = 1;
    }
    else
    {
      i0 = 1;
      i1 = 0;
    }

    if (two)
    {
      signe = 1.0;
    }
    else
    {
      signe = -1.0;
    }

    Vector3d dirPerp2 = new Vector3d();
    Vector3d dir = (Vector3d) (points[lineVertex.Branch(i)[i1]] - points[lineVertex.Branch(i)[i0]]);
    Vector3d dirPerp = Vector3d.CrossProduct(dir, signe * Vector3d.ZAxis);
    dirPerp.Unitize();
    //double angle = signe * 10.0;

    double angleTampon;
    double angle = 10.0;
    angle = angle * signe;
    //More than one branch
    if (vertexVertexes.Branch(lineVertex.Branch(i)[i1]).Count > 1)
    {
      isEnd = false;
      for (int j = 0; j < vertexVertexes.Branch(lineVertex.Branch(i)[i1]).Count; j++)
      {
        if (vertexVertexes.Branch(lineVertex.Branch(i)[i1])[j] != lineVertex.Branch(i)[i0])
        {
          Vector3d dir2 = (Vector3d) (points[vertexVertexes.Branch(lineVertex.Branch(i)[i1])[j]] - points[lineVertex.Branch(i)[i1]]);
          Vector3d dirPerp2Tampon = Vector3d.CrossProduct(dir2, signe * Vector3d.ZAxis);
          dirPerp2Tampon.Unitize();

          angleTampon = Angle(dirPerp2Tampon, dirPerp);
          if (signe > 0)
          {
            if (angleTampon < angle)
            {
              angle = angleTampon;
              dirPerp2 = dirPerp2Tampon;
            }
          }
          else
          {
            if ( angleTampon > angle)
            {
              angle = angleTampon;
              dirPerp2 = dirPerp2Tampon;
            }
          }
        }
      }
    }
      //Line as an End
    else
    {
      isEnd = true;
      angle = 0.0;
      dirPerp2 = dirPerp;
    }
    if (width / (2.0 * Math.Cos(angle / 2) * Math.Cos(angle / 2)) > 100)

    {
      return new Line(points[lineVertex.Branch(i)[i1]], points[lineVertex.Branch(i)[i1]] - width * (dirPerp + dirPerp2));
    }
    else
      return new Line(points[lineVertex.Branch(i)[i1]], points[lineVertex.Branch(i)[i1]] - width * (dirPerp + dirPerp2) / (2.0 * Math.Cos(angle / 2) * Math.Cos(angle / 2)));
  }

  //Thic function replicate SandBox lines topology
  //As inputs there are lines
  //Tolerance is used to glued points thar are close to each others
  //Outputs are
  //points list of Point3d
  //linePoint dataTree containing the points index number for end and beginning of the line
  //pointPoint dataTree containing the points index number for each other point connected to this point
  public static void LineTopology(List < Line > lines, double tolerance, ref List<Point3d> points, ref DataTree<int> linePoint, ref DataTree<int> pointPoint, ref  DataTree<int> pointLine)
  {
    for (int n_line = 0; n_line < lines.Count; n_line++)
    {
      bool addPoint = true;
      int nPoint = 0;
      for (int i = 0; i < points.Count; i++)
      {
        if (points[i].DistanceTo(lines[n_line].From) < tolerance)
        {
          addPoint = false;
          nPoint = i;
        }
      }
      if (addPoint)
      {
        points.Add(lines[n_line].From);
        linePoint.Add(points.Count - 1, new GH_Path(n_line));
      }
      else
      {
        linePoint.Add(nPoint, new GH_Path(n_line));
      }

      addPoint = true;
      for (int i = 0; i < points.Count; i++)
      {
        if (points[i].DistanceTo(lines[n_line].To) < tolerance)
        {
          addPoint = false;
          nPoint = i;
        }
      }
      if (addPoint)
      {
        points.Add(lines[n_line].To);
        linePoint.Add(points.Count - 1, new GH_Path(n_line));
      }
      else
      {
        linePoint.Add(nPoint, new GH_Path(n_line));
      }
    }
    for (int n_line = 0; n_line < linePoint.BranchCount; n_line++)
    {
      pointPoint.Add(linePoint.Branches[n_line][0], new GH_Path(linePoint.Branches[n_line][1]));
      pointPoint.Add(linePoint.Branches[n_line][1], new GH_Path(linePoint.Branches[n_line][0]));
    }

    for (int j = 0; j < linePoint.BranchCount; j++)
    {
      pointLine.Add(j, new GH_Path(linePoint.Branch(j)[0]));
      pointLine.Add(j, new GH_Path(linePoint.Branch(j)[1]));
    }

  }
  ///End lineTopology

  public static double Angle(Vector3d v1, Vector3d v2)
  {
    double output = -10;
    v1.Unitize();
    v2.Unitize();
    double g1 = Math.Acos(Math.Max(Math.Min(v1 * v2, 1.0), -1.0));
    Vector3d cross = Vector3d.CrossProduct(v1, v2);
    double g2 = Math.Asin(Math.Max(Math.Min(cross.Z, 1.0), -1.0));

    if (g2 >= 0)
    {
      output = g1;
    }

    else
    {
      if (g1 >= 0)
      {
        output = 2 * Math.PI - g1;
      }
      else
      {
        output = g2 + Math.PI;
      }
    }
    if (output > Math.PI) output = output - 2 * Math.PI;
    return (output % Math.PI);
  }
  ///////////////////////////
  public class LDPanel
  {
    public LDSide side1;
    public LDSide side2;
    public int lineNumber;

    public List<int> ToList()
    {
      List<int> output = new List<int>();
      output.Add(side1.nodeNumber);
      output.Add(side2.nodeNumber);
      output.Add(lineNumber);
      return output;
    }
    public Brep ToBrep()
    {
      List<Curve> curves = new List<Curve>();
      curves.Add(side1.ToCurve());
      curves.Add(side2.ToCurve());
      // Brep[] output = Brep.CreateFromLoft(curves, side1.point, side2.point, LoftType.Normal, false);
      Brep[] output = Brep.CreateFromLoft(curves, Point3d.Unset, Point3d.Unset, LoftType.Normal, false);

      if (output.Length > 0) return output[0];
      else return null;
    }


    public Mesh ToMesh(int nu, int nv, double angle, double radius, ref List<Point3d> fixedPoints, ref List<LineCurve> listUCurves, ref List<LineCurve> listVCurves, double deviation, bool zbool)
    {
      List < Point3d > pts1 = new  List < Point3d >();
      List < Point3d > pts2 = new  List < Point3d >();

      if (side1.isEnd)
      {
        pts1 = ToArcDeviation(side1.point, new Vector3d(side2.point - side1.point), side1.direction, angle, nv, deviation, zbool);
        fixedPoints.AddRange(pts1);
      }
      else
      {
        pts1 = ToLine(side1.point, side1.direction, nv, angle, radius, zbool);
      }

      if (side2.isEnd)
      {
        pts2 = ToArcDeviation(side2.point, new Vector3d(side1.point - side2.point), side2.direction, angle, nv, deviation, zbool);
        fixedPoints.AddRange(pts2);
      }
      else
      {
        pts2 = ToLine(side2.point, side2.direction, nv, angle, radius, zbool);
      }

      return PointsToMesh(pts1, pts2, nu, ref listUCurves, ref  listVCurves);
    }

    public Mesh ToMesh(int nu, int nv, double angle, double radius, ref List<Point3d> fixedPoints, ref DataTree<LineCurve> listUCurves, ref DataTree<LineCurve> listVCurves, double deviation, bool zbool)
    {
      List < Point3d > pts1 = new  List < Point3d >();
      List < Point3d > pts2 = new  List < Point3d >();

      if (side1.isEnd)
      {
        pts1 = ToArcDeviation(side1.point, new Vector3d(side2.point - side1.point), side1.direction, angle, nv, deviation, zbool);
        fixedPoints.AddRange(pts1);
      }
      else
      {
        pts1 = ToLine(side1.point, side1.direction, nv, angle, radius, zbool);
      }

      if (side2.isEnd)
      {
        pts2 = ToArcDeviation(side2.point, new Vector3d(side1.point - side2.point), side2.direction, angle, nv, deviation, zbool);
        fixedPoints.AddRange(pts2);
      }
      else
      {
        pts2 = ToLine(side2.point, side2.direction, nv, angle, radius, zbool);
      }

      return PointsToMesh(pts1, pts2, nu, ref listUCurves, ref  listVCurves);
    }


    public LDPanel(LDSide s1, LDSide s2, int line)
    {
      side1 = s1;
      side2 = s2;
      lineNumber = line;
    }
    public bool Touch(LDPanel other)
    {
      bool output = false;
      Vector3d vect = new Vector3d();
      if (other.side1.nodeNumber == side1.nodeNumber)
      {
        vect = other.side1.direction - side1.direction;
        if (vect.Length < 0.001) output = true;
      }

      if (other.side2.nodeNumber == side1.nodeNumber)
      {
        vect = other.side2.direction - side1.direction;
        if (vect.Length < 0.001) output = true;
      }

      if (other.side1.nodeNumber == side2.nodeNumber)
      {
        vect = other.side1.direction - side2.direction;
        if (vect.Length < 0.001) output = true;
      }

      if (other.side2.nodeNumber == side2.nodeNumber)
      {
        vect = other.side2.direction - side2.direction;
        if (vect.Length < 0.001) output = true;
      }

      return output;
    }



  }
  public static  List<LDPanel>  GetIntersections(List<LDPanel> lines, List<LDPanel> source)
  {
    List<LDPanel> output = new List<LDPanel>();

    for (int i = 0; i < lines.Count; i++)
    {
      for (int j = 0; j < source.Count; j++)
      {
        if (lines[i].Touch(source[j]))
        {
          bool test = true;
          for (int k = 0; k < output.Count; k++)
          {
            if (source[j].lineNumber == output[k].lineNumber) test = false;
          }
          if (test) output.Add(source[j]);
        }
      }
    }
    return output;
  }
  public class LDSide
  {
    public int nodeNumber;
    public Point3d point;
    public Vector3d direction;
    public bool isEnd;
    public LDSide()
    {
      nodeNumber = -1;
      point = new Point3d(Point3d.Unset);
      direction = new Vector3d(Vector3d.Unset);
      isEnd = true;
    }

    public LDSide(LDSide side)
    {
      LDSideSet(side.nodeNumber, side.point, side.direction, side.isEnd);
    }
    public LDSide(int n, Point3d pt, Vector3d dir, bool end)
    {
      nodeNumber = n;
      point = new Point3d(pt);
      direction = new Vector3d(dir);
      isEnd = end;
    }
    public void LDSideSet(int n, Point3d pt, Vector3d dir, bool end)
    {
      nodeNumber = n;
      point = new Point3d(pt);
      direction = new Vector3d(dir);
      isEnd = end;
    }
    public Curve ToCurve()
    {
      return new LineCurve(point, (Point3d) (point + direction));
    }
  }
  /////////////////////////////////////////////////////
  public static List<Point3d> ToArc(Point3d zero, Vector3d x, Vector3d y, double angle, int n, bool zbool)
  {
    List<Point3d> output = new List<Point3d>();

    Vector3d x_unit = new Vector3d(x);
    x_unit.Unitize();
    if (zbool) x_unit = Vector3d.ZAxis;

    Vector3d y_unit = new Vector3d(y);
    y_unit.Unitize();

    double width = y.Length;
    double angle0 = 0.0;

    if (Math.Abs(angle) < 0.01)
    {
      for (int i = 0; i < n; i++)
      {
        angle0 = angle * (double) i / (double) (n - 1);
        Vector3d x1 = x_unit * ( width * angle0);
        Vector3d y1 = y_unit * width * (double) i / (double) (n - 1);
        output.Add(new Point3d(zero + x1 + y1));
      }
    }
    else
    {
      for (int i = 0; i < n; i++)
      {
        angle0 = angle * (double) i / (double) (n - 1);
        Vector3d x1 = x_unit * ( width / Math.Sin(angle) * (1.0 - Math.Cos(angle0)));
        Vector3d y1 = y_unit * ( width * Math.Sin(angle0) / Math.Sin(angle));
        output.Add(new Point3d(zero + x1 + y1));
      }
    }
    return output;
  }
  /////////////////////////////////////////////////////
  public static List<Point3d> ToArcDeviation(Point3d zero, Vector3d x, Vector3d y, double angle, int n, double maxDeviation, bool zbool)
  {
    List<Point3d> output = new List<Point3d>();
    Vector3d x_unit = new Vector3d(x);
    x_unit.Unitize();
    if (zbool) x_unit = Vector3d.ZAxis;

    Vector3d y_unit = new Vector3d(y);
    y_unit.Unitize();

    double width = y.Length;
    double angle0 = 0.0;
    double deviation = 1.2;
    if (Math.Abs(angle) < 0.01)
    {
      for (int i = 0; i < n; i++)
      {
        deviation = ((double) i % 2.0) * maxDeviation;
        angle0 = angle * (double) i / (double) (n - 1);
        Vector3d x1 = x_unit * (deviation * width * angle0);
        Vector3d y1 = y_unit * width * (double) i / (double) (n - 1);
        output.Add(new Point3d(zero + x1 + y1));
      }
    }
    else
    {
      double angle_max;
      if (angle > Math.PI / 2)
      {
        angle_max = Math.PI / 2;
      }
      else
      {
        if (angle < -Math.PI / 2) angle_max = -Math.PI / 2;
        else angle_max = angle;
      }

      for (int i = 0; i < n; i++)
      {
        deviation = ((double) i % 2.0) * maxDeviation;
        angle0 = angle * (double) i / (double) (n - 1);
        Vector3d x1 = x_unit * (width / Math.Sin(angle_max) * (1.0 - Math.Cos(angle0)) - deviation * Math.Cos(angle0));
        Vector3d y1 = y_unit * ( width / Math.Sin(angle_max) + deviation) * Math.Sin(angle0);
        output.Add(new Point3d(zero + x1 + y1));
      }
    }
    return output;
  }
  /////////////////////////////////////////////////////
  public static List<Point3d> ToLine(Point3d zero, Vector3d y, int n, double angle0, double radius, bool zbool)
  {
    List<Point3d> output = new List<Point3d>();
    if (zbool)
    {
      double angle;
      //y.Unitize();
      Vector3d z = Vector3d.ZAxis;

      for (int i = 0; i < n; i++)
      {
        angle = Math.Abs(angle0) * (double) i / (double) (n - 1);
        output.Add(new Point3d(zero + y * Math.Sin(angle) + z * Math.Sign(angle0) * radius * (1 - Math.Cos(angle))));
      }

    }
    else
    {
      for (int i = 0; i < n; i++)
      {
        output.Add(new Point3d(zero + y * (double) i / (double) (n - 1)));
      }
    }
    return output;

    //return ToArc(zero, new Vector3d(0.0, 0.0, 0.0), y, angle, n, zbool);
  }
  /////////////////////////////////////////////////////
  public static Mesh PointsToMesh(List<Point3d> pts1, List<Point3d>  pts2, int nx, ref List<LineCurve> listUCurves, ref List<LineCurve> listVCurves)
  {
    int ny = pts1.Count;

    Rhino.Geometry.Mesh mesh = new Rhino.Geometry.Mesh();

    for (int iy = 0; iy < ny; iy++)
    {
      for (int ix = 0; ix < nx; ix++)
      {

        mesh.Vertices.Add(new Point3d(pts1[iy] + (pts2[iy] - pts1[iy]) * (double) ix / (double) (nx - 1)));
      }
    }
    int i0, i1, i2, i3;
    for (int ix = 0; ix < (nx - 1); ix++)
    {
      for (int iy = 0; iy < (ny - 1); iy++)
      {
        i0 = ix + iy * nx;
        i1 = (ix + 1) + iy * nx;
        i2 = (ix + 1) + (iy + 1) * nx;
        i3 = ix + (iy + 1) * nx;
        mesh.Faces.AddFace(i0, i1, i2, i3);
        listUCurves.Add(new LineCurve(mesh.Vertices[i0], mesh.Vertices[i1]));
        listVCurves.Add(new LineCurve(mesh.Vertices[i1], mesh.Vertices[i2]));
        listUCurves.Add(new LineCurve(mesh.Vertices[i2], mesh.Vertices[i3]));
        listVCurves.Add(new LineCurve(mesh.Vertices[i3], mesh.Vertices[i0]));
      }
    }
    mesh.Normals.ComputeNormals();
    mesh.Compact();
    return mesh;
  }
  /////////////////////////////////////////////////////
  public static Mesh PointsToMesh(List<Point3d> pts1, List<Point3d>  pts2, int nx, ref DataTree<LineCurve> listUCurves, ref DataTree<LineCurve> listVCurves)
  {
    int ny = pts1.Count;

    Rhino.Geometry.Mesh mesh = new Rhino.Geometry.Mesh();

    for (int iy = 0; iy < ny; iy++)
    {
      for (int ix = 0; ix < nx; ix++)
      {

        mesh.Vertices.Add(new Point3d(pts1[iy] + (pts2[iy] - pts1[iy]) * (double) ix / (double) (nx - 1)));
      }
    }
    int i0, i1, i2, i3;
    for (int ix = 0; ix < (nx - 1); ix++)
    {
      for (int iy = 0; iy < (ny - 1); iy++)
      {
        i0 = ix + iy * nx;
        i1 = (ix + 1) + iy * nx;
        i2 = (ix + 1) + (iy + 1) * nx;
        i3 = ix + (iy + 1) * nx;
        mesh.Faces.AddFace(i0, i1, i2, i3);
        listUCurves.Add(new LineCurve(mesh.Vertices[i0], mesh.Vertices[i1]), new GH_Path(iy));
        listVCurves.Add(new LineCurve(mesh.Vertices[i1], mesh.Vertices[i2]), new GH_Path(iy));
        listUCurves.Add(new LineCurve(mesh.Vertices[i2], mesh.Vertices[i3]), new GH_Path(iy + 1));
        listVCurves.Add(new LineCurve(mesh.Vertices[i3], mesh.Vertices[i0]), new GH_Path(iy));
      }
    }
    mesh.Normals.ComputeNormals();
    mesh.Compact();
    return mesh;
  }
# ---------- end c_script ----------
end = EndPoints(Curve=c_script.U)  # -> Start, End
clean = CombineClean(Meshes=flatten(c_script.M))
clean_2 = CombineClean(Meshes=flatten(c_script.M))
data = Data(c_script.F)
anchor = Anchor(Point=c_script.F, Strength=10000)
duppt = RemoveDuplicatePts(Points=[end.End, end.Start], Tolerance=0.01)  # -> simplify(UniquePoints)
dupln = RemoveDuplicateLines(Lines=c_script.V, Tolerance=0.01)  # -> simplify(UniqueLines)
pressure = Pressure(M=clean, Strength=inflate)
dupln_2 = RemoveDuplicateLines(Lines=c_script.U, Tolerance=0.01)  # -> simplify(UniqueLines)
dupln_3 = RemoveDuplicateLines(Lines=c_script.V, Tolerance=0.01)  # -> simplify(UniqueLines)
Z = UnitZ(Factor=graft(mass))
show = Show(G=clean)
load = Load(Point=duppt, ForceVector=Z, Weighting=1)
length_line = LengthLine(Line=dupln, Length=spring_v_length, Strength=Slider(10, range=0..10))
length_line_2 = LengthLine(Line=dupln_2, Length=spring_u_length, Strength=Slider(10, range=0..10))
entwine = Entwine(
    Branch00=show,
    Branch01=anchor,
    Branch02=length_line_2,
    Branch03=load,
    Branch04=length_line,
    Branch05=pressure,
    FlattenInputs=True)  # -> flatten(Result)
solver = Solver(GoalObjects=entwine, Reset=button, Threshold=1e-15, Tolerance=0.01, On=toggle)  # -> I, V, O
item = ListItem(List=solver.O, Index=0, Wrap=True)
mesh = Mesh(item)
