# Grasshopper definition agents.gh (Grasshopper 1.0.7)

number_slider = Slider(150, range=0..1000)
rectangle = Rectangle(Plane=PlaneXY(0, 0, 0), XSize=number_slider, YSize=number_slider, Radius=0)  # -> Rectangle, Length
pop2d = Populate2D(Region=rectangle.Rectangle, Count=Slider(299, range=0..1000), Seed=1)
c_script = CSharpScript(reset=Button(), startPts=pop2d)  # -> out, A, B, C; inputs reset: Boolean, startPts: list of Point3d
# ---------- c_script: C# additional code ----------
  // global variable list
  static List<Agent> agentList = new List<Agent>();
  static List<Point3d> ptList = new List<Point3d>();
  static List<Vector3d> speedList = new List<Vector3d>();
# ---------- end c_script ----------
panel = Panel(c_script.C)
vdis = VectorDisplay(Anchor=c_script.A, Vector=c_script.B)
