# Grasshopper definition gameoflife.gh (Grasshopper 1.0.7)
# plug-ins: ScriptParasite

pt = Point([Point(11.93182679, 6.324984476, 0), Point(6.310092679, 10.78398943, 0), Point(7.332034857, 20.79520601, 0), Point(13.49537884, 20.63774435, 0), Point(18.95550822, 17.78447477, 0), Point(17.16644176, 5.121612169, 0)])
number_slider = Slider(30, range=0..100)
number_slider_2 = Slider(30, range=0..100)
intcrv = Interpolate(Vertices=pt, Degree=3, Periodic=invert(False), KnotStyle=1)  # -> Curve, Length, Domain
sqgrid = Square(Plane=PlaneXY(0, 0, 0), Size=1, ExtentX=number_slider, ExtentY=number_slider_2)  # -> Cells, Points
crv = Curve(intcrv.Curve)
rec = Rectangle(sqgrid.Cells)
pt_2 = Point(sqgrid.Points)
area = Area(Geometry=rec)  # -> Area, Centroid
incurve = PointInCurve(Point=area.Centroid, Curve=crv)  # -> Relationship, Point
addition = Addition(A=number_slider, B="1")
addition_2 = Addition(A=number_slider_2, B="1")
equals = Equality(FirstNumber=incurve.Relationship, SecondNumber="2")  # -> Equality, Inequality
number_slider_3 = Slider(0, range=0..200)
panel = Panel(equals.Equality)
flatten = FlattenTree(Tree=equals.Equality, Path="{0}")
panel_2 = Panel("""2
3""")
toggle = BooleanToggle(False)
cull = CullPattern(List=area.Centroid, CullPattern=equals.Equality)
timer = Timer(TimerInterval=50, Target=gameoflife)  # disabled
path = FilePath("D:\GitHub\trkRhinoGHcs\scriptparasite\GameOfLife\")

gameoflife = CSharpScript(
    cells=flatten,
    rows=number_slider_2,
    columns=number_slider,
    birthRule="3",
    survivalRule=panel_2,
    run=Toggle(False),
    reset=Button())  # -> out, previous, newIteration, A; inputs cells: list of Boolean, rows: Int32, columns: Int32, birthRule: list of Int32, survivalRule: list of Int32, run: Boolean, reset: Boolean
# ---------- gameoflife: C# ----------
            //Sanity
            if (run == false)
            {
                return;
            }

            if (cells.Count != rows * columns)
            {
                Component.AddRuntimeMessage(GH_RuntimeMessageLevel.Error, "something weird with dimension of grid");
                return;
            }

            if (reset == true)
            {
                //turn list into 2d array
                prevCells = new bool[columns, rows];
                int it = 0;

                for (int j = 0; j < columns; j++)
                {
                    for (int i = 0; i < rows; i++)
                    {
                        prevCells[j, i] = cells[it];
                        it++;
                    }
                }

            }

            //new array of alive/dead cells for next iteration
            // bool[,] prevCells = new bool[columns, rows];
            // bool[,] newCells = cellArray;

            // bool[,] newCells = new bool[columns, rows];
            int[,] nCount = new int[columns, rows];
            // for (int k = 0; k < iterations; k++)
            // {
            // switch previous cells with new ones
            // prevCells = newCells;
            bool[,] newCells = new bool[columns, rows];

            for (int j = 0; j < columns; j++)
            {
                for (int i = 0; i < rows; i++)
                {

                    //compute alive neighbors
                    int aliveNeighbors = 0;
                    int ni, nj;

                    // topleft
                    ni = i + 1;
                    nj = j - 1;
                    if (ni > rows - 1) ni = 0;
                    else if (ni < 0) ni = rows - 1;
                    if (nj > columns - 1) nj = 0;
                    else if (nj < 0) nj = columns - 1;
                    if (prevCells[nj, ni] == true) aliveNeighbors++;

                    // top
                    ni = i + 1;
                    nj = j;
                    if (ni > rows - 1) ni = 0;
                    else if (ni < 0) ni = rows - 1;
                    if (nj > columns - 1) nj = 0;
                    else if (nj < 0) nj = columns - 1;
                    if (prevCells[nj, ni] == true) aliveNeighbors++;

                    // topright
                    ni = i + 1;
                    nj = j + 1;
                    if (ni > rows - 1) ni = 0;
                    else if (ni < 0) ni = rows - 1;
                    if (nj > columns - 1) nj = 0;
                    else if (nj < 0) nj = columns - 1;
                    if (prevCells[nj, ni] == true) aliveNeighbors++;

                    // left
                    ni = i;
                    nj = j - 1;
                    if (ni > rows - 1) ni = 0;
                    else if (ni < 0) ni = rows - 1;
                    if (nj > columns - 1) nj = 0;
                    else if (nj < 0) nj = columns - 1;
                    if (prevCells[nj, ni] == true) aliveNeighbors++;

                    // right
                    ni = i;
                    nj = j + 1;
                    if (ni > rows - 1) ni = 0;
                    else if (ni < 0) ni = rows - 1;
                    if (nj > columns - 1) nj = 0;
                    else if (nj < 0) nj = columns - 1;
                    if (prevCells[nj, ni] == true) aliveNeighbors++;

                    // bottomleft
                    ni = i - 1;
                    nj = j - 1;
                    if (ni > rows - 1) ni = 0;
                    else if (ni < 0) ni = rows - 1;
                    if (nj > columns - 1) nj = 0;
                    else if (nj < 0) nj = columns - 1;
                    if (prevCells[nj, ni] == true) aliveNeighbors++;

                    // bottom
                    ni = i - 1;
                    nj = j;
                    if (ni > rows - 1) ni = 0;
                    else if (ni < 0) ni = rows - 1;
                    if (nj > columns - 1) nj = 0;
                    else if (nj < 0) nj = columns - 1;
                    if (prevCells[nj, ni] == true) aliveNeighbors++;

                    // bottomright
                    ni = i - 1;
                    nj = j + 1;
                    if (ni > rows - 1) ni = 0;
                    else if (ni < 0) ni = rows - 1;
                    if (nj > columns - 1) nj = 0;
                    else if (nj < 0) nj = columns - 1;
                    if (prevCells[nj, ni] == true) aliveNeighbors++;

                    // Print("alive neighbors: " + aliveNeighbors);
                    nCount[j, i] = aliveNeighbors;

                    //compute new state
                    bool prevState = prevCells[j, i];
                    bool newState = false;

                    //if cells were dead
                    if (prevState == false)
                    {
                        foreach (int b in birthRule)
                        {
                            if (b == aliveNeighbors)
                            {
                                newState = true;
                                break;
                            }
                        }
                    }

                    //if cell was alive
                    else
                    {
                        foreach (int s in survivalRule)
                        {
                            if (s == aliveNeighbors)
                            {
                                newState = true;
                                break;
                            }
                        }
                    }

                    //store new state in array
                    newCells[j, i] = newState;
                }
                // }
            }

            // outputs
            previous = prevCells;
            newIteration = newCells;
            A = nCount;
            //Print("end of script");
            // updateCount++;
            // B = updateCount;

            // store new cells for next iteration
            prevCells = newCells;
# ---------- gameoflife: C# additional code ----------
bool[,] prevCells;
        // int updateCount;
# ---------- end gameoflife ----------
scriptpar = ScriptParasite(Enable=Toggle(True), Folder=path)

flatten_2 = FlattenTree(Tree=rec, Path="{0}")
flatten_3 = FlattenTree(Tree=area.Centroid, Path="{0}")
panel_3 = Panel(gameoflife.A)
panel_4 = Panel(gameoflife.newIteration)
cull_2 = CullPattern(List=flatten_2, CullPattern=gameoflife.newIteration)
panel_5 = Panel(gameoflife.previous)
boundary = BoundarySurfaces(Edges=cull_2)
number_slider_4 = Slider(0.7, range=0..1)  # disabled
dots = DotDisplay(Colour=RGB(38, 222, 173), Size=0.3)  # disabled
dots_2 = DotDisplay(Point=cull, Colour=RGB(222, 38, 124), Size=0.2)  # disabled
panel_6 = Panel(gameoflife.out)
tag = TextTag3D(Location=flatten_3, Text=gameoflife.A, Size=number_slider_4, Justification=7)  # disabled
